# Grasshopper definition Extrudedlines.gh (Grasshopper 1.0.8)
# plug-ins: eleFront

geo = Geometry([<point referenced from the Rhino model> x5000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])
getkv = GetAllKeysValues(AttributesOrAttributedGeometry=geo)  # -> Keys, simplify(flatten(Values)), BakeName
multiplication = Multiplication(A="10", B=getkv.Values)
Z = UnitZ(Factor=multiplication)
move = Move(Geometry=geo, Motion=Z)  # -> Geometry, Transform
ln = Line(StartPoint=geo, EndPoint=move.Geometry)
pdecon = Deconstruct(Point=Z)  # -> XComponent, YComponent, ZComponent
bnd = Bounds(Numbers=pdecon.ZComponent)
dedomain = DeconstructDomain(Domain=bnd)  # -> Start, End
gradient = Gradient(
    LowerLimit=dedomain.Start,
    UpperLimit=dedomain.End,
    Parameter=pdecon.ZComponent,
    stops=[0: RGB(235, 192, 192), 0.268: RGB(194, 26, 0)])
cir = Circle(Plane=move.Geometry, Radius=Slider(6, range=0..10))
srf = Surface(cir)
preview = CustomPreview(Geometry=srf, Material=gradient)
