# Grasshopper definition Points.gh (Grasshopper 1.0.8)
# plug-ins: Heron, eleFront

# ----
# SET ANCHOR POINT
# The earth anchor point has to be set in any case.
# The 0,0,0 point of Rhino has to be set to a real world coordinate.
# You can get the point by searching for it. Or you simply look up a place in google maps, copy/paste the cooridantes and plug them into the "SetEAP" component.
panel = Panel("Victoria Park, London")
restgeocode = ESRIRESTServiceGeocode(Addresses=panel)  # -> Candidates, Latitude, Longitude
lat = Panel("45.437126")
long = Panel("12.344741")
panel_2 = Panel(restgeocode.Candidates)
branch = TreeBranch(Tree=restgeocode.Candidates, Path="0;0", MaintainPaths=True)
branch_2 = TreeBranch(Tree=restgeocode.Latitude, Path="0;0", MaintainPaths=True)
branch_3 = TreeBranch(Tree=restgeocode.Longitude, Path="0;0", MaintainPaths=True)
panel_3 = Panel(branch)
seteap = SetEarthAnchorPoint(SetEAP=Toggle(True), Latitude=branch_2, Longitude=branch_3)

path = FilePath("C:\Users\TUF\Desktop\Architecture\UCL\Design\General_Flickr_Scrapping\RhinoVIsulization\By year\2021\Castello_2021.csv")
file = ReadFile(File=path, PerLineParse=True)
panel_4 = Panel(file)
cull_i = CullIndex(List=file, Indices="0", Wrap=True)
tab = Panel(",")
split = TextSplit(Text=cull_i, Separators=tab)
panel_5 = Panel(split)
item = ListItem(List=split, Index="5", Wrap=True)  # -> Item, Item1

seteap_2 = SetEarthAnchorPoint(SetEAP=Button(), Latitude=lat, Longitude=long)
split_2 = TextSplit(Text=split, Separators="\t")
py3 = Python3Script(x=item.Item1)  # -> out, a
# ---------- py3: Python ----------
# Convert x to a decimal (float)
try:
    a = float(x)
except:
    result = None
# ---------- end py3 ----------
flatten = FlattenTree(Tree=py3.a, Path="{0}")
py3_2 = Python3Script(x=item.Item)  # -> out, a; same code as py3
flatten_2 = FlattenTree(Tree=py3_2.a, Path="{0}")

flatten_3 = FlattenTree(Tree=item.Item, Path="{0}")
flatten_4 = FlattenTree(Tree=item.Item1, Path="{0}")
# CONVERT COORDINATES TO XY VALUES
ddtoxy = DecimalDegreesToXY(Latitude=flatten_2, Longitude=flatten)  # -> XyPoint, Transform
geo = Geometry(ddtoxy.XyPoint)
panel_6 = Panel(ddtoxy.XyPoint)

# ----
# Bake with attributes (optional)
item_2 = ListItem(List=split, Index="3", Wrap=True)
tstat = TreeStatistics(Tree=item_2)  # -> Paths, Length, Count
dup = DuplicateData(Data="Text_Blob_Sentiment", Number=tstat.Length, Order=True)  # -> simplify(Data)
ef_att = EleFrontAttributes(Keys=dup, Values=item_2, Layer="Points")  # -> flatten(Attributes), Keys, Values, Name, Layer, ColourSource, DisplayColour, MaterialSource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
bake = BakeObjects(Geometry=geo, Attributes=ef_att.Attributes, Bake=False, createGroups=False)  # -> Message, Ghosts

panel_7 = Panel(flatten_2)
panel_8 = Panel(py3_2.a)
