# Grasshopper definition Waveform.gh (Grasshopper 1.0.8)
# plug-ins: Human, superSerial

geo = Geometry(<point referenced from the Rhino model>)

# ---- group: Input
# SPATIAL BINNING IN GRASSHOPPER
geo_2 = Geometry([<point referenced from the Rhino model> x5000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])
x = Panel("27")
y = Panel("21")

# ---- group: Inclusion
sqgrid = Square(Plane=PlaneXY(0, 0, 0), Size="100", ExtentX=x, ExtentY=y)  # -> flatten(Cells), Points
area = Area(Geometry=sqgrid.Cells)  # -> Area, Centroid
merge = Merge(Data1=geo_2, Data2=area.Centroid)
pt = Point(merge)
incurves = PointInCurves(Point=pt, Curves=sqgrid.Cells)  # -> Relationship, Index, Point

# ---- group: Check one cell
equals = Equality(FirstNumber=incurves.Index, SecondNumber="12")  # -> Equality, Inequality
cull = CullPattern(List=pt, CullPattern=equals.Equality)
panel = Panel(cull)

# ---- group: Check all cells
multiplication = Multiplication(A=x, B=y)
series = Series(Start=0, Step=1, Count=multiplication)  # -> simplify(graft(Series))
equals_2 = Equality(FirstNumber=incurves.Index, SecondNumber=series)  # -> Equality, Inequality
cull_2 = CullPattern(List=pt, CullPattern=equals_2.Equality)
panel_2 = Panel(cull_2)

# ----
# How do you read the result?
# 
# The first line isn0 | 21
# and that means that Point 0 is in
# curve 21
# 
# Same is true for
# 1 | 21
# 
# And the third line is 2 | 12
# and that means that point 2
# is in curve 12.
panel_3 = Panel(incurves.Index)
tstat = TreeStatistics(Tree=cull_2)  # -> Paths, Length, Count

# ---- group: Surface Grid
# Add contrast by "streching" the numbers
bnd = Bounds(Numbers=flatten(tstat.Length))
dom = ConstructDomain(DomainStart="0", DomainEnd="4000")
remap = RemapNumbers(Value=tstat.Length, Source=bnd, Target=dom)  # -> Mapped, Clipped
Z = UnitZ(Factor=remap.Mapped)
move = Move(Geometry=area.Centroid, Motion=Z)  # -> Geometry, Transform
srfgrid = SurfaceFromPoints(Points=move.Geometry, UCount=x, Interpolate=False)

# ---- group: Graphics & Baking
number_slider = Slider(1, range=0..1)
contour = Contour(Shape=srfgrid, Point=Point(0, 0, 0), Direction=Vector(0, 0, 1), Distance=Slider(10, range=0..10))
eval = EvaluateCurve(Curve=contour, Parameter=0)  # -> Point, Tangent, Angle
pdecon = Deconstruct(Point=eval.Point)  # -> XComponent, YComponent, ZComponent
bnd_2 = Bounds(Numbers=flatten(pdecon.ZComponent))
dedomain = DeconstructDomain(Domain=bnd_2)  # -> Start, End
gradient = Gradient(
    LowerLimit=dedomain.Start,
    UpperLimit=dedomain.End,
    Parameter=flatten(pdecon.ZComponent),
    stops=[0.0431: RGB(255, 255, 255), 0.666: RGB(220, 0, 40)])
preview = CustomPreview(Geometry=flatten(contour), Material=gradient)
createatts = CreateAttributes(LayerName="Contours", Color=gradient, enableFullPath=False)
bake = BakeGeometry(Bake=Button(), Geometry=flatten(contour), Attributes=createatts, DeleteOldBakes=False, PreserveTrees=False)

# ----
superserial = SuperSerial(Switch=Toggle(False), Baud="9600", Port="COM3", Mode=2, Trigger=False)  # -> Status, Sent, Received
panel_4 = Panel(superserial.Received)
rec = DataRecorder(panel_4, DataLimit=-10, RecordData=True)
panel_5 = Panel(rec)
