# Grasshopper definition Extrudelines.gh (Grasshopper 1.0.8)
# plug-ins: Human, eleFront5

geo = Geometry([<point referenced from the Rhino model> x217])
pline = PolyLine(Vertices=geo, Closed=False)
getkv = GetAllKeysValues(AttributesOrAttributedGeometry=geo)  # -> Keys, simplify(flatten(Values)), BakeName
multiplication = Multiplication(A="1", B=getkv.Values)
Z = UnitZ(Factor=multiplication)
move = Move(Geometry=geo, Motion=Z)  # -> Geometry, Transform
pdecon = Deconstruct(Point=Z)  # -> XComponent, YComponent, ZComponent
ln = Line(StartPoint=geo, EndPoint=move.Geometry)
pline_2 = PolyLine(Vertices=move.Geometry, Closed=False)
bnd = Bounds(Numbers=pdecon.ZComponent)
dedomain = DeconstructDomain(Domain=bnd)  # -> Start, End
gradient = Gradient(
    LowerLimit=dedomain.Start,
    UpperLimit=dedomain.End,
    Parameter=pdecon.ZComponent,
    stops=[0: RGB(0, 128, 0), 0.5: RGB(255, 255, 0), 1: RGB(255, 0, 0)])
cir = Circle(Plane=move.Geometry, Radius=Slider(1, range=0..10))
srf = Surface(cir)
createatts = CreateAttributes(Color=gradient, enableFullPath=False)
preview = CustomPreview(Geometry=ln, Material=gradient)
bake = BakeGeometry(Bake=Button(), Geometry=ln, Attributes=createatts, DeleteOldBakes=False, PreserveTrees=False)
